# Grasshopper definition cap_2.1_volume_superfície.gh (Grasshopper 0.9.76)
# plug-ins: Python Interpreter

xy = XYPlane(Origin=Point(0, 0, 0))
python = PythonScript(plane=xy)  # -> out, sph; inputs plane: Plane
# ---------- python: Python ----------
import rhinoscriptsyntax as rs
import math

pt = 0,0,0
radius = 1
height = 2
width = 2

sph = rs.AddSphere(pt, radius)
area = 4 * math.pi * radius**2
print(area)
volume = (4/3) * math.pi * radius**3
print(volume)
relacao = area/volume
print(relacao)


cyl = rs.AddCylinder(pt, height, radius, cap=True)
# ---------- end python ----------
